# Grasshopper definition games1.gh (Grasshopper 1.0.7)
# plug-ins: horsterCameraControl, Kangaroo Components, Firefly, Weaverbird, Kangaroo2 Components

pt = ConstructPoint(XCoordinate=0, YCoordinate=0, ZCoordinate=0)
pt_2 = ConstructPoint(XCoordinate=0, YCoordinate=0, ZCoordinate=0)
wbicosahedron = WeaverbirdsMeshMeshIcosahedron(Plane=pt, Radius=Slider(0.8, range=0..10))
wbicosahedron_2 = WeaverbirdsMeshMeshIcosahedron(Plane=pt_2, Radius=Slider(0.8, range=0..10))
mesh = Mesh(wbicosahedron)
mesh_2 = Mesh(wbicosahedron_2)
wbcatmullclark = WeaverbirdsCatmullClarkSubdivision(MeshCurves=mesh, Level=Slider(1, range=0..1), SmoothNakedEdges=1)
wbcatmullclark_2 = WeaverbirdsCatmullClarkSubdivision(MeshCurves=mesh_2, Level=Slider(1, range=0..1), SmoothNakedEdges=1)
demesh = DeconstructMesh(Mesh=wbcatmullclark)  # -> Vertices, Faces, Colours, Normals
demesh_2 = DeconstructMesh(Mesh=wbcatmullclark_2)  # -> Vertices, Faces, Colours, Normals
wbcatmullclark_3 = WeaverbirdsCatmullClarkSubdivision(MeshCurves=wbcatmullclark, Level=Slider(3, range=0..10), SmoothNakedEdges=1)
wbcatmullclark_4 = WeaverbirdsCatmullClarkSubdivision(MeshCurves=wbcatmullclark_2, Level=Slider(3, range=0..10), SmoothNakedEdges=1)
medges = MeshEdges(Mesh=wbcatmullclark_3)  # -> NakedEdges, InteriorEdges, NonManifoldEdges
demesh_3 = DeconstructMesh(Mesh=wbcatmullclark_3)  # -> Vertices, Faces, Colours, Normals
medges_2 = MeshEdges(Mesh=wbcatmullclark_4)  # -> NakedEdges, InteriorEdges, NonManifoldEdges
demesh_4 = DeconstructMesh(Mesh=wbcatmullclark_4)  # -> Vertices, Faces, Colours, Normals
merge = Merge(Data1=medges.NakedEdges, Data2=medges.InteriorEdges)
merge_2 = Merge(Data1=medges_2.NakedEdges, Data2=medges_2.InteriorEdges)
cp = ClosestPoint(Point=demesh.Vertices, Cloud=demesh_3.Vertices)  # -> ClosestPoint, CPIndex, Distance
vec2pt = Vector2Pt(PointA=demesh_3.Vertices, PointB=pt, Unitize=False)  # -> Vector, Length
# Pads
cp_2 = ClosestPoint(Point=demesh_2.Vertices, Cloud=demesh_4.Vertices)  # -> ClosestPoint, CPIndex, Distance
len = Length(Curve=merge)
vec2pt_2 = Vector2Pt(PointA=demesh_4.Vertices, PointB=pt_2, Unitize=False)  # -> Vector, Length
len_2 = Length(Curve=merge_2)
amp = Amplitude(Vector=vec2pt.Vector, Amplitude=Slider(0.03, range=-0.2..0.5))
multiplication = Multiplication(A=len, B=Slider(0.8, range=0..1))
amp_2 = Amplitude(Vector=vec2pt_2.Vector, Amplitude=Slider(-0.03, range=-0.2..0.5))
multiplication_2 = Multiplication(A=len_2, B=Slider(0.8, range=0..1))
length_line = LengthLine(Line=merge, Length=multiplication, Strength=10)
anchor = Anchor(Point=cp.ClosestPoint, Strength=1000)
length_line_2 = LengthLine(Line=merge_2, Length=multiplication_2, Strength=10)
anchor_2 = Anchor(Point=cp_2.ClosestPoint, Strength=1000)
show = Show(G=wbcatmullclark_3)
show_2 = Show(G=wbcatmullclark_4)
load = Load(Point=demesh_3.Vertices, ForceVector=amp)
load_2 = Load(Point=demesh_4.Vertices, ForceVector=amp_2)
merge_3 = Merge(Data1=flatten(show), Data2=flatten(anchor), Data3=flatten(length_line), Data4=flatten(load))
merge_4 = Merge(Data1=flatten(show_2), Data2=flatten(anchor_2), Data3=flatten(length_line_2), Data4=flatten(load_2))
solver = Solver(
    GoalObjects=merge_3,
    Reset=Button(),
    Restart=False,
    Parallel=True,
    Threshold=1e-15,
    Tolerance=0.01,
    AddCurrent=False,
    On=True)  # -> V, O
solver_2 = Solver(
    GoalObjects=merge_4,
    Reset=Button(),
    Restart=False,
    Parallel=True,
    Threshold=1e-15,
    Tolerance=0.01,
    AddCurrent=False,
    On=True)  # -> V, O
item = ListItem(List=solver.O, Index=0, Wrap=True)
item_2 = ListItem(List=solver_2.O, Index=0, Wrap=True)
demesh_5 = DeconstructMesh(Mesh=item)  # -> Vertices, Faces, Colours, Normals
demesh_6 = DeconstructMesh(Mesh=item_2)  # -> Vertices, Faces, Colours, Normals
# scale of pads
number_slider = Slider(0.7, range=0..1)
number_slider_2 = Slider(2, range=0..10)
dist = Distance(PointA=pt, PointB=demesh_5.Vertices)
bnd = Bounds(Numbers=dist)
remap = RemapNumbers(Value=dist, Source=bnd, Target=Domain(0, 1))  # -> Mapped, Clipped
gradient = Gradient(
    LowerLimit=0,
    UpperLimit=1,
    Parameter=remap.Mapped,
    stops=[0.12: RGB(139, 0, 0), 0.289: RGB(240, 128, 128), 0.506: RGB(100, 149, 237), 0.512: RGB(175, 238, 238), 1: RGB(0, 0, 205)])
dist_2 = Distance(PointA=pt_2, PointB=demesh_6.Vertices)
bnd_2 = Bounds(Numbers=dist_2)
remap_2 = RemapNumbers(Value=dist_2, Source=bnd_2, Target=Domain(0, 1))  # -> Mapped, Clipped
gradient_2 = Gradient(
    LowerLimit=0,
    UpperLimit=1,
    Parameter=remap_2.Mapped,
    stops=[0.12: RGB(139, 0, 0), 0.289: RGB(240, 128, 128), 0.506: RGB(100, 149, 237), 0.512: RGB(175, 238, 238), 1: RGB(0, 0, 205)])
mcol = MeshColours(Mesh=item, Colours=gradient)
mcol_2 = MeshColours(Mesh=item_2, Colours=gradient_2)
scale_nu = ScaleNU(Geometry=mcol_2, Plane=PlaneXY(0, 0, 0), ScaleX=number_slider_2, ScaleY=1, ScaleZ=number_slider)  # -> Geometry, Transform
scale_nu_2 = ScaleNU(Geometry=mcol, Plane=PlaneXY(0, 0, 0), ScaleX=number_slider_2, ScaleY=1, ScaleZ=number_slider)  # -> Geometry, Transform
item_3 = ListItem(List=[scale_nu.Geometry, scale_nu_2.Geometry], Index=0, Wrap=True)
move = Move(Geometry=item_3, Motion=Vector(0, 0, 10))  # -> Geometry, Transform
mesh_3 = Mesh(move.Geometry)
falling_shape_height = Slider(1, range=0..10)
number_slider_3 = Slider(8, range=0..100)
falling_intervals = Slider(8, range=-5..12)
toggle = BooleanToggle(True)
width_of_board = Number(10)
height_of_board = Number(10)
counter = Counter(Reset=toggle)
# Falling objects with slider
falling_intervals_2 = Slider(0, range=0..20)
timer = Timer(TimerInterval=3000, Target=counter)
addition = Addition(A=counter, B=1)
timer_2 = Timer(TimerInterval=3000, Target=counter_2)
number_slider_4 = Slider(2, range=0..10)
mod = Modulus(A=addition, B=2)
bool = Boolean(mod)
panel = Panel(bool)
counter_2 = Counter(Reset=toggle)

# ----
# communicating with Arduino
# via serail port
# Check the BAUDRATE
ports_available = COMPortsAvailable()
toggle_2 = BooleanToggle(False)
panel_2 = Panel(ports_available)
select_the_right_port = ListItem(List=panel_2, Index=2, Wrap=True)
panel_3 = Panel(select_the_right_port)
open_port = OpenClosePort(OpenClosePort=toggle_2, PortNumber=panel_3, BaudRate="9600")
read = SerialReadGeneric(StartReadingValues=toggle_2, PortNumber=panel_3)  # -> SerialOutput, StatusMessage
panel_4 = Panel(open_port)

number_slider_5 = Slider(11, range=0..100)
vec = VectorXYZ(XComponent=5, YComponent=0, ZComponent=number_slider_3)  # -> Vector, Length
vec_2 = VectorXYZ(XComponent=10, YComponent=0, ZComponent=number_slider_3)  # -> Vector, Length
neg = Negative(Value=falling_intervals)
# Falling objects with floor
# this is the shape choosenning
vec_3 = VectorXYZ(XComponent=0, YComponent=0, ZComponent=number_slider_3)  # -> Vector, Length
neg_2 = Negative(Value=falling_intervals_2)
how_fast_the_fall = Slider(0.015, range=-0.001..0.1)
# This is the gravity componet -
#  the direction in which the objects are falling
Z = UnitZ(Factor=1)
python = GhPythonScript(shape_range=Slider(2, range=0..10), is_reset=mod)  # -> out, a
# ---------- python: Python ----------
__author__ = "Maya lulko"
__version__ = "2020.01.31"

import rhinoscriptsyntax as rs
import random as rnd
if is_reset:
    a= rnd.randint(0,shape_range)
else:
    a=shape_range+1
# ---------- end python ----------
addition_2 = Addition(A=counter_2, B=1)
number_slider_6 = Slider(25, range=0..100)
# Falling objects with gravity component
vec_4 = VectorXYZ(XComponent=0, YComponent=0, ZComponent=30)  # -> Vector, Length
box = DomainBox(Base=vec_4.Vector, X=number_slider_5, Y=number_slider_5, Z=number_slider_5)
addition_3 = Addition()
sph = Sphere(Base=vec_2.Vector, Radius=1)
box_2 = CenterBox(Base=vec.Vector, X=1, Y=number_slider_4, Z=number_slider_4)
box_3 = CenterBox(Base=vec_3.Vector, X=1, Y=1, Z=1)
# this is the gravity object
number_slider_7 = Slider(-100, range=-1000..1000)
addition_4 = Addition(A=neg, B=width_of_board)
addition_5 = Addition(A=neg_2, B=height_of_board)
mod_2 = Modulus(A=addition_2, B=2)
number_slider_8 = Slider(25, range=0..100)
neg_3 = Negative(Value=Z)
# This is how you generate text
vec_5 = VectorXYZ(XComponent=0, YComponent=0, ZComponent=0)  # -> Vector, Length
mesh_4 = Mesh([box_3, sph, box_2])
panel_5 = Panel(python.a)
python_2 = GhPythonScript(x=addition_4, y=width_of_board)  # -> out, a
# ---------- python_2: Python ----------
__author__ = "Maya lulko"
__version__ = "2020.02.12"

import rhinoscriptsyntax as rs

if x <= 0:
    a=0
elif x>=y:
    a=y
else:
    a=x
# ---------- end python_2 ----------
pad_height = Slider(1, range=0..10)
panel_6 = Panel(mod_2)
timer_3 = Timer(TimerInterval=20, Target=read)
tag = TextTag(Location=vec_5.Vector, Text="HI")
item_4 = ListItem(List=mesh_4, Index=python.a, Wrap=True)
neg_4 = Negative(Value=number_slider_7)
vec_6 = VectorXYZ(XComponent=0, YComponent=0, ZComponent=addition_5)  # -> Vector, Length
mesh_5 = Mesh(item_4)
Z_2 = UnitZ(Factor=neg_4)
vec_7 = VectorXYZ(XComponent=0, YComponent=python_2.a, ZComponent=0)  # -> Vector, Length
xy = XYPlane(Origin=Point(0, 0, 0))
panel_7 = Panel(mesh_5)
mbox = MeshBox(Base=box, XCount=10, YCount=10, ZCount=10)
demesh_7 = DeconstructMesh(Mesh=mbox)  # -> Vertices, Faces, Colours, Normals
gravity = Gravity(M=mbox, F=number_slider_7)
addition_6 = Addition(A=number_slider_8, B=number_slider_6)
python_3 = GhPythonScript(obj_coord=vec_6.Vector, B_HEIGHT=height_of_board)  # -> out, a
# ---------- python_3: Python ----------
__author__ = "Maya lulko"
__version__ = "2020.02.12"

import rhinoscriptsyntax as rs


if obj_coord[2] <= 0:
    a=rs.CreateVector(0,0,B_HEIGHT)
else:
    a=obj_coord
# ---------- end python_3 ----------
# Making the floor valid!
solidplanecollide = SolidPlaneCollide(Solid=mesh_5, CollisionPlane=xy, Strength=1)
bool_2 = Boolean(mod_2)
panel_8 = Panel(bool_2)
addition_7 = Addition(A=addition_6, B=number_slider_6)
vec_8 = VectorXYZ(XComponent=5, YComponent=0, ZComponent=number_slider_8)  # -> Vector, Length
uforce = UnaryForce(Point=demesh_7.Vertices, Force=Z_2)
timer_4 = Timer(TimerInterval=20, Target=kangaroo)
panel_9 = Panel(python_3.a)
vec_9 = VectorXYZ(XComponent=5, YComponent=0, ZComponent=addition_7)  # -> Vector, Length
top_box = CenterBox(Base=vec_9.Vector, X=5, Y=1, Z=number_slider_6)
down_box = CenterBox(Base=vec_8.Vector, X=5, Y=1, Z=number_slider_8)
python_4 = GhPythonScript(x=read.SerialOutput)  # -> out, shp_loc, pad_loc, points, shape
# ---------- python_4: Python ----------
__author__ = "Maya lulko"
__version__ = "2020.02.15"

import rhinoscriptsyntax as rs

split_data = x.split(";")
shp_loc = split_data[0]
#shp_loc = int(shape[0]), int(shape[1]), int(shape[2])
pad_loc = split_data[1]
#pad_loc = int(pad[0]), int(pad[1]), int(pad[2])
points = float(split_data[2])
shape = int(split_data[3])
# ---------- end python_4 ----------
panel_10 = Panel(python_4.points)
rigidbody = RigidBody(Part=mesh_5, Strength=10)  # -> RigidBody, Planes
pt_3 = Point(rigidbody.Planes)
load_3 = Load(Point=pt_3, ForceVector=neg_3, Weighting=how_fast_the_fall)
# python code component.
# you can add outputs and inputs
# by zooming in and clicking the + signs
# in this toy example it does nothing really
# but it's a super easy way to parse the info
# coming from Arduino as strings
panel_11 = Panel(read.SerialOutput)
box_4 = CenterBox(Base=python_3.a, X=1, Y=1, Z=falling_shape_height)
grab = Grab(On=True, Strength=1, Range=3)
pad = CenterBox(Base=vec_7.Vector, X=1, Y=Slider(3, range=0..5), Z=pad_height)
kangaroo = KangarooPhysics(ForceObjects=gravity, Settings=null, Geometry=mbox, SimulationReset=Toggle(True))  # -> Out, Iterations, ParticlesOut, GeometryOut, KE
mbox_2 = MeshBox(Base=box_4, XCount=10, YCount=10, ZCount=10)
mbox_3 = MeshBox(Base=pad, XCount=10, YCount=10, ZCount=10)
rigidbody_2 = RigidBody(Part=mbox_3, Strength=10)  # -> RigidBody, Planes
num = Number(python_4.points)
bouncysolver = BouncySolver(
    GoalObjects=[rigidbody.RigidBody, solidplanecollide, load_3, grab],
    Reset=bool_2,
    Threshold=1e-15,
    Tolerance=0.01,
    Damping=0.99,
    Iterations=15,
    On=True)  # -> I, V, O
number_slider_9 = Slider(5, range=0..10)
number_slider_10 = Slider(33, range=0..100)
solidcollide = SolidCollide(MeshA=mbox_2, MeshB=mbox_3, Strength=1)
panel_13 = Panel(python_4.pad_loc)
rigidbody_3 = RigidBody(Part=mbox_2, Strength=10)  # -> RigidBody, Planes
mesh_6 = Mesh(kangaroo.GeometryOut)
python_5 = GhPythonScript(point=python_4.shp_loc)  # -> out, x, y, z
# ---------- python_5: Python ----------
__author__ = "Maya lulko"
__version__ = "2020.02.15"

import rhinoscriptsyntax as rs

p = point.split(",")
x= float(p[0])
y= float(p[1])
z= float(p[2])
# ---------- end python_5 ----------
number_slider_11 = Slider(-1, range=-1..0)
python_6 = GhPythonScript(point=python_4.pad_loc)  # -> out, x, y, z
# ---------- python_6: Python ----------
__author__ = "Maya lulko"
__version__ = "2020.02.15"

import rhinoscriptsyntax as rs
p = point.split(",")
print(p)
x= float(p[0])
y= float(p[1])
z= float(p[2])
# ---------- end python_6 ----------
number_slider_12 = Slider(1, range=0..10)
vec_10 = VectorXYZ(XComponent=0, YComponent=0, ZComponent=0)  # -> Vector, Length
panel_14 = Panel(bouncysolver.V)
vec_11 = Vector(bouncysolver.V)
panel_15 = Panel(python_5.x)
vec_12 = VectorXYZ(XComponent=number_slider_9, YComponent=Slider(-32, range=-106..105), ZComponent=Slider(200, range=-5..255))  # -> Vector, Length
vec_13 = VectorXYZ(XComponent=number_slider_9, YComponent=Slider(6, range=0..100), ZComponent=Slider(-15, range=-100..10))  # -> Vector, Length
vec_14 = VectorXYZ(XComponent=python_6.x, YComponent=python_6.y, ZComponent=python_6.z)  # -> Vector, Length
vec_15 = VectorXYZ(XComponent=5, YComponent=0.1, ZComponent=50)  # -> Vector, Length
vec_16 = VectorXYZ(XComponent=0, YComponent=number_slider_11, ZComponent=num)  # -> Vector, Length
setcam = SetCamera(CameraLocation=vec_13.Vector, TargetLocation=vec_12.Vector, Activate=Toggle(True))
vec_17 = VectorXYZ(XComponent=10, YComponent=number_slider_12, ZComponent=100)  # -> Vector, Length
cyl = Cylinder(Base=vec_10.Vector, Radius=Slider(0.965, range=0..1), Length=1)
vec_18 = VectorXYZ(XComponent=10, YComponent=number_slider_12, ZComponent=0)  # -> Vector, Length
vec_19 = VectorXYZ(XComponent=0, YComponent=number_slider_11, ZComponent=num)  # -> Vector, Length
top_box_2 = Box2Pt(PointA=vec_16.Vector, PointB=vec_17.Vector, Plane=PlaneXY(0, 0, 0))
cap = CapHoles(Brep=cyl)
the_cuttout_box = CenterBox(Base=vec_15.Vector, X=4.9, Y=1, Z=49.8)
buttom_box = Box2Pt(PointA=vec_19.Vector, PointB=vec_18.Vector, Plane=PlaneXY(0, 0, 0))
vec_20 = VectorXYZ(XComponent=python_5.x, YComponent=python_5.y, ZComponent=python_5.z)  # -> Vector, Length
mdif = MeshDifference(MeshesA=[top_box_2, buttom_box], MeshesB=the_cuttout_box)
move_2 = Move(Geometry=cap, Motion=vec_14.Vector)  # -> Geometry, Transform
item_5 = ListItem(List=mdif, Index=0, Wrap=True)
item_6 = ListItem(List=mdif, Index=1, Wrap=True)
mcol_3 = MeshColours(Mesh=item_5, Colours=RGB(224, 46, 0))
mdif_2 = MeshDifference(MeshesA=item_6, MeshesB=move_2.Geometry)
mcol_4 = MeshColours(Mesh=mdif_2, Colours=RGB(151, 254, 232))
pt_4 = ConstructPoint(XCoordinate=0, YCoordinate=0, ZCoordinate=0)
pt_5 = ConstructPoint(XCoordinate=0, YCoordinate=0, ZCoordinate=0)
wbicosahedron_3 = WeaverbirdsMeshMeshIcosahedron(Plane=pt_4, Radius=Slider(0.8, range=0..10))
wbicosahedron_4 = WeaverbirdsMeshMeshIcosahedron(Plane=pt_5, Radius=Slider(0.8, range=0..10))
mesh_7 = Mesh(wbicosahedron_3)
mesh_8 = Mesh(wbicosahedron_4)
pt_6 = ConstructPoint(XCoordinate=0, YCoordinate=0, ZCoordinate=0)
wbicosahedron_5 = WeaverbirdsMeshMeshIcosahedron(Plane=pt_6, Radius=Slider(0.8, range=0..10))
pt_7 = ConstructPoint(XCoordinate=0, YCoordinate=0, ZCoordinate=0)
wbicosahedron_6 = WeaverbirdsMeshMeshIcosahedron(Plane=pt_7, Radius=Slider(0.8, range=0..10))
wbcatmullclark_5 = WeaverbirdsCatmullClarkSubdivision(MeshCurves=mesh_7, Level=Slider(1, range=0..1), SmoothNakedEdges=1)
wbcatmullclark_6 = WeaverbirdsCatmullClarkSubdivision(MeshCurves=mesh_8, Level=Slider(1, range=0..1), SmoothNakedEdges=1)
pt_8 = ConstructPoint(XCoordinate=0, YCoordinate=0, ZCoordinate=0)
wbicosahedron_7 = WeaverbirdsMeshMeshIcosahedron(Plane=pt_8, Radius=Slider(0.8, range=0..10))
mesh_9 = Mesh(wbicosahedron_5)
pt_9 = ConstructPoint(XCoordinate=0, YCoordinate=0, ZCoordinate=0)
mesh_10 = Mesh(wbicosahedron_6)
wbicosahedron_8 = WeaverbirdsMeshMeshIcosahedron(Plane=pt_9, Radius=Slider(0.8, range=0..10))
pt_10 = ConstructPoint(XCoordinate=0, YCoordinate=0, ZCoordinate=0)
demesh_8 = DeconstructMesh(Mesh=wbcatmullclark_5)  # -> Vertices, Faces, Colours, Normals
demesh_9 = DeconstructMesh(Mesh=wbcatmullclark_6)  # -> Vertices, Faces, Colours, Normals
wbicosahedron_9 = WeaverbirdsMeshMeshIcosahedron(Plane=pt_10, Radius=Slider(0.8, range=0..10))
mesh_11 = Mesh(wbicosahedron_7)
wbcatmullclark_7 = WeaverbirdsCatmullClarkSubdivision(MeshCurves=mesh_9, Level=Slider(1, range=0..1), SmoothNakedEdges=1)
wbcatmullclark_8 = WeaverbirdsCatmullClarkSubdivision(MeshCurves=mesh_10, Level=Slider(1, range=0..1), SmoothNakedEdges=1)
mesh_12 = Mesh(wbicosahedron_8)
wbcatmullclark_9 = WeaverbirdsCatmullClarkSubdivision(MeshCurves=wbcatmullclark_5, Level=Slider(3, range=0..10), SmoothNakedEdges=1)
wbcatmullclark_10 = WeaverbirdsCatmullClarkSubdivision(MeshCurves=wbcatmullclark_6, Level=Slider(3, range=0..10), SmoothNakedEdges=1)
pt_11 = ConstructPoint(XCoordinate=0, YCoordinate=0, ZCoordinate=0)
wbicosahedron_10 = WeaverbirdsMeshMeshIcosahedron(Plane=pt_11, Radius=Slider(0.8, range=0..10))
wbcatmullclark_11 = WeaverbirdsCatmullClarkSubdivision(MeshCurves=mesh_11, Level=Slider(1, range=0..1), SmoothNakedEdges=1)
mesh_13 = Mesh(wbicosahedron_9)
demesh_10 = DeconstructMesh(Mesh=wbcatmullclark_7)  # -> Vertices, Faces, Colours, Normals
wbcatmullclark_12 = WeaverbirdsCatmullClarkSubdivision(MeshCurves=mesh_12, Level=Slider(1, range=0..1), SmoothNakedEdges=1)
demesh_11 = DeconstructMesh(Mesh=wbcatmullclark_8)  # -> Vertices, Faces, Colours, Normals
mesh_14 = Mesh(wbicosahedron_10)
medges_3 = MeshEdges(Mesh=wbcatmullclark_9)  # -> NakedEdges, InteriorEdges, NonManifoldEdges
demesh_12 = DeconstructMesh(Mesh=wbcatmullclark_9)  # -> Vertices, Faces, Colours, Normals
wbcatmullclark_13 = WeaverbirdsCatmullClarkSubdivision(MeshCurves=wbcatmullclark_7, Level=Slider(3, range=0..10), SmoothNakedEdges=1)
medges_4 = MeshEdges(Mesh=wbcatmullclark_10)  # -> NakedEdges, InteriorEdges, NonManifoldEdges
demesh_13 = DeconstructMesh(Mesh=wbcatmullclark_10)  # -> Vertices, Faces, Colours, Normals
wbcatmullclark_14 = WeaverbirdsCatmullClarkSubdivision(MeshCurves=mesh_13, Level=Slider(1, range=0..1), SmoothNakedEdges=1)
wbcatmullclark_15 = WeaverbirdsCatmullClarkSubdivision(MeshCurves=wbcatmullclark_8, Level=Slider(3, range=0..10), SmoothNakedEdges=1)
demesh_14 = DeconstructMesh(Mesh=wbcatmullclark_11)  # -> Vertices, Faces, Colours, Normals
demesh_15 = DeconstructMesh(Mesh=wbcatmullclark_12)  # -> Vertices, Faces, Colours, Normals
wbcatmullclark_16 = WeaverbirdsCatmullClarkSubdivision(MeshCurves=mesh_14, Level=Slider(1, range=0..1), SmoothNakedEdges=1)
wbcatmullclark_17 = WeaverbirdsCatmullClarkSubdivision(MeshCurves=wbcatmullclark_11, Level=Slider(3, range=0..10), SmoothNakedEdges=1)
merge_5 = Merge(Data1=medges_3.NakedEdges, Data2=medges_3.InteriorEdges)
merge_6 = Merge(Data1=medges_4.NakedEdges, Data2=medges_4.InteriorEdges)
wbcatmullclark_18 = WeaverbirdsCatmullClarkSubdivision(MeshCurves=wbcatmullclark_12, Level=Slider(3, range=0..10), SmoothNakedEdges=1)
demesh_16 = DeconstructMesh(Mesh=wbcatmullclark_14)  # -> Vertices, Faces, Colours, Normals
medges_5 = MeshEdges(Mesh=wbcatmullclark_13)  # -> NakedEdges, InteriorEdges, NonManifoldEdges
demesh_17 = DeconstructMesh(Mesh=wbcatmullclark_13)  # -> Vertices, Faces, Colours, Normals
medges_6 = MeshEdges(Mesh=wbcatmullclark_15)  # -> NakedEdges, InteriorEdges, NonManifoldEdges
demesh_18 = DeconstructMesh(Mesh=wbcatmullclark_15)  # -> Vertices, Faces, Colours, Normals
wbcatmullclark_19 = WeaverbirdsCatmullClarkSubdivision(MeshCurves=wbcatmullclark_14, Level=Slider(3, range=0..10), SmoothNakedEdges=1)
demesh_19 = DeconstructMesh(Mesh=wbcatmullclark_16)  # -> Vertices, Faces, Colours, Normals
medges_7 = MeshEdges(Mesh=wbcatmullclark_17)  # -> NakedEdges, InteriorEdges, NonManifoldEdges
demesh_20 = DeconstructMesh(Mesh=wbcatmullclark_17)  # -> Vertices, Faces, Colours, Normals
cp_3 = ClosestPoint(Point=demesh_8.Vertices, Cloud=demesh_12.Vertices)  # -> ClosestPoint, CPIndex, Distance
cp_4 = ClosestPoint(Point=demesh_9.Vertices, Cloud=demesh_13.Vertices)  # -> ClosestPoint, CPIndex, Distance
merge_7 = Merge(Data1=medges_5.NakedEdges, Data2=medges_5.InteriorEdges)
number_slider_13 = Slider(10, range=0..10)
vec2pt_3 = Vector2Pt(PointA=demesh_12.Vertices, PointB=pt_4, Unitize=False)  # -> Vector, Length
wbcatmullclark_20 = WeaverbirdsCatmullClarkSubdivision(MeshCurves=wbcatmullclark_16, Level=Slider(3, range=0..10), SmoothNakedEdges=1)
vec2pt_4 = Vector2Pt(PointA=demesh_13.Vertices, PointB=pt_5, Unitize=False)  # -> Vector, Length
medges_8 = MeshEdges(Mesh=wbcatmullclark_18)  # -> NakedEdges, InteriorEdges, NonManifoldEdges
len_3 = Length(Curve=merge_5)
demesh_21 = DeconstructMesh(Mesh=wbcatmullclark_18)  # -> Vertices, Faces, Colours, Normals
len_4 = Length(Curve=merge_6)
merge_8 = Merge(Data1=medges_6.NakedEdges, Data2=medges_6.InteriorEdges)
medges_9 = MeshEdges(Mesh=wbcatmullclark_19)  # -> NakedEdges, InteriorEdges, NonManifoldEdges
demesh_22 = DeconstructMesh(Mesh=wbcatmullclark_19)  # -> Vertices, Faces, Colours, Normals
wbdodecahedron = WeaverbirdsPolylinesDodecahedron(Plane=PlaneXY(0, 0, 0), Radius=Slider(6, range=0..10))
merge_9 = Merge(Data1=medges_7.NakedEdges, Data2=medges_7.InteriorEdges)
merge_10 = Merge(Data1=medges_8.NakedEdges, Data2=medges_8.InteriorEdges)
cp_5 = ClosestPoint(Point=demesh_10.Vertices, Cloud=demesh_17.Vertices)  # -> ClosestPoint, CPIndex, Distance
amp_3 = Amplitude(Vector=vec2pt_3.Vector, Amplitude=Slider(-0.01, range=-0.2..0.5))
amp_4 = Amplitude(Vector=vec2pt_4.Vector, Amplitude=Slider(0, range=-0.2..0.5))
medges_10 = MeshEdges(Mesh=wbcatmullclark_20)  # -> NakedEdges, InteriorEdges, NonManifoldEdges
vec2pt_5 = Vector2Pt(PointA=demesh_17.Vertices, PointB=pt_6, Unitize=False)  # -> Vector, Length
demesh_23 = DeconstructMesh(Mesh=wbcatmullclark_20)  # -> Vertices, Faces, Colours, Normals
multiplication_3 = Multiplication(A=len_3, B=Slider(0.8, range=0..1))
cp_6 = ClosestPoint(Point=demesh_11.Vertices, Cloud=demesh_18.Vertices)  # -> ClosestPoint, CPIndex, Distance
len_5 = Length(Curve=merge_7)
multiplication_4 = Multiplication(A=len_4, B=Slider(0.8, range=0..1))
vec2pt_6 = Vector2Pt(PointA=demesh_18.Vertices, PointB=pt_7, Unitize=False)  # -> Vector, Length
len_6 = Length(Curve=merge_8)
length_line_3 = LengthLine(Line=merge_5, Length=multiplication_3, Strength=10)
merge_11 = Merge(Data1=medges_9.NakedEdges, Data2=medges_9.InteriorEdges)
length_line_4 = LengthLine(Line=merge_6, Length=multiplication_4, Strength=10)
anchor_3 = Anchor(Point=cp_3.ClosestPoint, Strength=1000)
anchor_4 = Anchor(Point=cp_4.ClosestPoint, Strength=1000)
brep = Brep(wbdodecahedron)
number_slider_14 = Slider(10, range=0..10)
cp_7 = ClosestPoint(Point=demesh_14.Vertices, Cloud=demesh_20.Vertices)  # -> ClosestPoint, CPIndex, Distance
show_3 = Show(G=wbcatmullclark_9)
vec2pt_7 = Vector2Pt(PointA=demesh_20.Vertices, PointB=pt_8, Unitize=False)  # -> Vector, Length
# BAD Shapes
show_4 = Show(G=wbcatmullclark_10)
len_7 = Length(Curve=merge_9)
merge_12 = Merge(Data1=medges_10.NakedEdges, Data2=medges_10.InteriorEdges)
cp_8 = ClosestPoint(Point=demesh_15.Vertices, Cloud=demesh_21.Vertices)  # -> ClosestPoint, CPIndex, Distance
vec2pt_8 = Vector2Pt(PointA=demesh_21.Vertices, PointB=pt_9, Unitize=False)  # -> Vector, Length
# THE SHAPES
box_5 = CenterBox(Base=PlaneXY(0, 0, 0), X=number_slider_13, Y=number_slider_13, Z=number_slider_13)
len_8 = Length(Curve=merge_10)
load_4 = Load(Point=demesh_12.Vertices, ForceVector=amp_3)
amp_5 = Amplitude(Vector=vec2pt_5.Vector, Amplitude=Slider(-0.02, range=-0.2..0.5))
load_5 = Load(Point=demesh_13.Vertices, ForceVector=amp_4)
multiplication_5 = Multiplication(A=len_5, B=Slider(0.8, range=0..1))
amp_6 = Amplitude(Vector=vec2pt_6.Vector, Amplitude=Slider(-0.015, range=-0.2..0.5))
multiplication_6 = Multiplication(A=len_6, B=Slider(0.8, range=0..1))
cp_9 = ClosestPoint(Point=demesh_16.Vertices, Cloud=demesh_22.Vertices)  # -> ClosestPoint, CPIndex, Distance
length_line_5 = LengthLine(Line=merge_7, Length=multiplication_5, Strength=10)
anchor_5 = Anchor(Point=cp_5.ClosestPoint, Strength=1000)
vec2pt_9 = Vector2Pt(PointA=demesh_22.Vertices, PointB=pt_10, Unitize=False)  # -> Vector, Length
len_9 = Length(Curve=merge_11)
length_line_6 = LengthLine(Line=merge_8, Length=multiplication_6, Strength=10)
anchor_6 = Anchor(Point=cp_6.ClosestPoint, Strength=1000)
amp_7 = Amplitude(Vector=vec2pt_7.Vector, Amplitude=Slider(0.01, range=-0.2..0.5))
show_5 = Show(G=wbcatmullclark_13)
merge_13 = Merge(Data1=flatten(show_3), Data2=flatten(anchor_3), Data3=flatten(length_line_3), Data4=flatten(load_4))
msphere = MeshSphere(Base=PlaneXY(0, 0, 0), Radius=10, UCount=10, VCount=20)
merge_14 = Merge(Data1=flatten(show_4), Data2=flatten(anchor_4), Data3=flatten(length_line_4), Data4=flatten(load_5))
multiplication_7 = Multiplication(A=len_7, B=Slider(0.8, range=0..1))
cp_10 = ClosestPoint(Point=demesh_19.Vertices, Cloud=demesh_23.Vertices)  # -> ClosestPoint, CPIndex, Distance
show_6 = Show(G=wbcatmullclark_15)
vec2pt_10 = Vector2Pt(PointA=demesh_23.Vertices, PointB=pt_11, Unitize=False)  # -> Vector, Length
amp_8 = Amplitude(Vector=vec2pt_8.Vector, Amplitude=Slider(-0.012, range=-0.2..0.5))
len_10 = Length(Curve=merge_12)
length_line_7 = LengthLine(Line=merge_9, Length=multiplication_7, Strength=10)
multiplication_8 = Multiplication(A=len_8, B=Slider(0.8, range=0..1))
anchor_7 = Anchor(Point=cp_7.ClosestPoint, Strength=1000)
load_6 = Load(Point=demesh_17.Vertices, ForceVector=amp_5)
mesh_15 = Mesh(wbdodecahedron)
load_7 = Load(Point=demesh_18.Vertices, ForceVector=amp_6)
length_line_8 = LengthLine(Line=merge_10, Length=multiplication_8, Strength=10)
anchor_8 = Anchor(Point=cp_8.ClosestPoint, Strength=1000)
show_7 = Show(G=wbcatmullclark_17)
amp_9 = Amplitude(Vector=vec2pt_9.Vector, Amplitude=Slider(0.045, range=-0.2..0.5))
multiplication_9 = Multiplication(A=len_9, B=Slider(0.8, range=0..1))
show_8 = Show(G=wbcatmullclark_18)
debrep = DeconstructBrep(Brep=box_5)  # -> Faces, Edges, Vertices
length_line_9 = LengthLine(Line=merge_11, Length=multiplication_9, Strength=10)
load_8 = Load(Point=demesh_20.Vertices, ForceVector=amp_7)
mbox_4 = MeshBox(Base=box_5, XCount=number_slider_14, YCount=number_slider_14, ZCount=number_slider_14)
anchor_9 = Anchor(Point=cp_9.ClosestPoint, Strength=1000)
merge_15 = Merge(Data1=flatten(show_5), Data2=flatten(anchor_5), Data3=flatten(length_line_5), Data4=flatten(load_6))
# THE SHAPES
number_slider_15 = Slider(1, range=0..1)
amp_10 = Amplitude(Vector=vec2pt_10.Vector, Amplitude=Slider(0.02, range=-0.2..0.5))
merge_16 = Merge(Data1=flatten(show_6), Data2=flatten(anchor_6), Data3=flatten(length_line_6), Data4=flatten(load_7))
load_9 = Load(Point=demesh_21.Vertices, ForceVector=amp_8)
multiplication_10 = Multiplication(A=len_10, B=Slider(0.8, range=0..1))
show_9 = Show(G=wbcatmullclark_19)
wbedges = WeaverbirdsMeshEdges(MeshOrPolylines=mbox_4)
length_line_10 = LengthLine(Line=merge_12, Length=multiplication_10, Strength=10)
anchor_10 = Anchor(Point=cp_10.ClosestPoint, Strength=1000)
merge_17 = Merge(Data1=flatten(show_7), Data2=flatten(anchor_7), Data3=flatten(length_line_7), Data4=flatten(load_8))
load_10 = Load(Point=demesh_22.Vertices, ForceVector=amp_9)
wbedges_2 = WeaverbirdsMeshEdges(MeshOrPolylines=msphere)
show_10 = Show(G=wbcatmullclark_20)
solver_3 = Solver(
    GoalObjects=merge_13,
    Reset=Button(),
    Restart=False,
    Parallel=True,
    Threshold=1e-15,
    Tolerance=0.01,
    AddCurrent=False,
    On=True)  # -> V, O
debrep_2 = DeconstructBrep(Brep=brep)  # -> Faces, Edges, Vertices
solver_4 = Solver(
    GoalObjects=merge_14,
    Reset=Button(),
    Restart=False,
    Parallel=True,
    Threshold=1e-15,
    Tolerance=0.01,
    AddCurrent=False,
    On=True)  # -> V, O
merge_18 = Merge(Data1=flatten(show_8), Data2=flatten(anchor_8), Data3=flatten(length_line_8), Data4=flatten(load_9))
load_11 = Load(Point=demesh_23.Vertices, ForceVector=amp_10)
faceb = FaceBoundaries(Mesh=msphere)
merge_19 = Merge(Data1=flatten(show_9), Data2=flatten(anchor_9), Data3=flatten(length_line_9), Data4=flatten(load_10))
len_11 = Length(Curve=wbedges)
wbedges_3 = WeaverbirdsMeshEdges(MeshOrPolylines=mesh_15)
len_12 = Length(Curve=wbedges_2)
merge_20 = Merge(Data1=flatten(show_10), Data2=flatten(anchor_10), Data3=flatten(length_line_10), Data4=flatten(load_11))
# GOOD Shapes
solver_5 = Solver(
    GoalObjects=merge_15,
    Reset=Button(),
    Restart=False,
    Parallel=True,
    Threshold=1e-15,
    Tolerance=0.01,
    AddCurrent=False,
    On=True)  # -> V, O
panel_16 = Panel(debrep_2.Vertices)
solver_6 = Solver(
    GoalObjects=merge_16,
    Reset=Button(),
    Restart=False,
    Parallel=True,
    Threshold=1e-15,
    Tolerance=0.01,
    AddCurrent=False,
    On=True)  # -> V, O
faceb_2 = FaceBoundaries(Mesh=mesh_15)
item_7 = ListItem(List=solver_3.O, Index=0, Wrap=True)
item_8 = ListItem(List=solver_4.O, Index=0, Wrap=True)
multiplication_11 = Multiplication(A=len_11, B=Slider(0.963, range=0..1))
boundary = BoundarySurfaces(Edges=faceb)
solver_7 = Solver(
    GoalObjects=merge_17,
    Reset=Button(),
    Restart=False,
    Parallel=True,
    Threshold=1e-15,
    Tolerance=0.01,
    AddCurrent=False,
    On=True)  # -> V, O
solver_8 = Solver(
    GoalObjects=merge_18,
    Reset=Button(),
    Restart=False,
    Parallel=True,
    Threshold=1e-15,
    Tolerance=0.01,
    AddCurrent=False,
    On=True)  # -> V, O
len_13 = Length(Curve=wbedges_3)
multiplication_12 = Multiplication(A=len_12, B=number_slider_15)
demesh_24 = DeconstructMesh(Mesh=item_7)  # -> Vertices, Faces, Colours, Normals
demesh_25 = DeconstructMesh(Mesh=item_8)  # -> Vertices, Faces, Colours, Normals
solver_9 = Solver(
    GoalObjects=merge_19,
    Reset=Button(),
    Restart=False,
    Parallel=True,
    Threshold=1e-15,
    Tolerance=0.01,
    AddCurrent=False,
    On=True)  # -> V, O
join = BrepJoin(Breps=boundary)  # -> Breps, Closed
boundary_2 = BoundarySurfaces(Edges=faceb_2)
item_9 = ListItem(List=solver_6.O, Index=0, Wrap=True)
item_10 = ListItem(List=solver_5.O, Index=0, Wrap=True)
solver_10 = Solver(
    GoalObjects=merge_20,
    Reset=Button(),
    Restart=False,
    Parallel=True,
    Threshold=1e-15,
    Tolerance=0.01,
    AddCurrent=False,
    On=True)  # -> V, O
springs = SpringsFromLine(Connection=wbedges, Stiffness=1000, Damping=10, RestLength=multiplication_11, UpperCutoff=0, LowerCutoff=0, Plasticity=0)
multiplication_13 = Multiplication(A=len_13, B=Slider(1, range=0..1))
springs_2 = SpringsFromLine(
    Connection=wbedges_2,
    Stiffness=1000,
    Damping=10,
    RestLength=multiplication_12,
    UpperCutoff=0,
    LowerCutoff=0,
    Plasticity=0)
item_11 = ListItem(List=solver_7.O, Index=0, Wrap=True)
item_12 = ListItem(List=solver_8.O, Index=0, Wrap=True)
brep_2 = Brep(join.Breps)
demesh_26 = DeconstructMesh(Mesh=item_9)  # -> Vertices, Faces, Colours, Normals
join_2 = BrepJoin(Breps=boundary_2)  # -> Breps, Closed
demesh_27 = DeconstructMesh(Mesh=item_10)  # -> Vertices, Faces, Colours, Normals
demesh_28 = DeconstructMesh(Mesh=item_11)  # -> Vertices, Faces, Colours, Normals
item_13 = ListItem(List=solver_9.O, Index=0, Wrap=True)
demesh_29 = DeconstructMesh(Mesh=item_12)  # -> Vertices, Faces, Colours, Normals
springs_3 = SpringsFromLine(
    Connection=wbedges_3,
    Stiffness=1000,
    Damping=10,
    RestLength=multiplication_13,
    UpperCutoff=0,
    LowerCutoff=0,
    Plasticity=0)
kangaroo_2 = KangarooPhysics(ForceObjects=springs, AnchorPoints=debrep.Vertices, Settings=null, Geometry=mbox_4, SimulationReset=Toggle(False))  # -> Out, Iterations, ParticlesOut, GeometryOut, KE
item_14 = ListItem(List=solver_10.O, Index=0, Wrap=True)
brep_3 = Brep(join_2.Breps)
debrep_3 = DeconstructBrep(Brep=brep_2)  # -> Faces, Edges, Vertices
lng = ListLength(List=debrep_3.Vertices)
demesh_30 = DeconstructMesh(Mesh=item_13)  # -> Vertices, Faces, Colours, Normals
python_7 = GhPythonScript(x=lng)  # -> out, a
# ---------- python_7: Python ----------
__author__ = "Maya lulko"
__version__ = "2020.02.26"

import rhinoscriptsyntax as rs

a= list(range(0,x,5))
# ---------- end python_7 ----------
demesh_31 = DeconstructMesh(Mesh=item_14)  # -> Vertices, Faces, Colours, Normals
lng_2 = ListLength(List=debrep_2.Vertices)
dist_3 = Distance(PointA=pt_6, PointB=demesh_27.Vertices)
dist_4 = Distance(PointA=pt_7, PointB=demesh_26.Vertices)
bnd_3 = Bounds(Numbers=dist_3)
item_15 = ListItem(List=debrep_3.Vertices, Index=python_7.a, Wrap=True)
pt_12 = Point(item_15)
kangaroo_3 = KangarooPhysics(ForceObjects=springs_2, AnchorPoints=pt_12, Settings=null, Geometry=msphere, SimulationReset=Toggle(True))  # -> Out, Iterations, ParticlesOut, GeometryOut, KE
python_8 = GhPythonScript(x=lng_2)  # -> out, a
# ---------- python_8: Python ----------
__author__ = "Maya lulko"
__version__ = "2020.02.26"

import rhinoscriptsyntax as rs

a= list(range(0,x,7))
# ---------- end python_8 ----------
bnd_4 = Bounds(Numbers=dist_4)
mesh_16 = Mesh(kangaroo_2.GeometryOut)
remap_3 = RemapNumbers(Value=dist_3, Source=bnd_3, Target=Domain(0, 1))  # -> Mapped, Clipped
item_16 = ListItem(List=debrep_2.Vertices, Index=python_8.a, Wrap=True)
pt_13 = Point(item_16)
kangaroo_4 = KangarooPhysics(ForceObjects=springs_3, AnchorPoints=pt_13, Settings=null, Geometry=mesh_15, SimulationReset=Toggle(True))  # -> Out, Iterations, ParticlesOut, GeometryOut, KE
remap_4 = RemapNumbers(Value=dist_4, Source=bnd_4, Target=Domain(0, 1))  # -> Mapped, Clipped
gradient_3 = Gradient(
    LowerLimit=0,
    UpperLimit=1,
    Parameter=remap_3.Mapped,
    stops=[0.12: RGB(139, 0, 0), 0.289: RGB(240, 128, 128), 0.506: RGB(100, 149, 237), 0.512: RGB(175, 238, 238), 1: RGB(0, 0, 205)])
gradient_4 = Gradient(
    LowerLimit=0,
    UpperLimit=1,
    Parameter=remap_4.Mapped,
    stops=[0.12: RGB(139, 0, 0), 0.289: RGB(240, 128, 128), 0.506: RGB(100, 149, 237), 0.512: RGB(175, 238, 238), 1: RGB(0, 0, 205)])
mesh_17 = Mesh(kangaroo_3.GeometryOut)
mesh_18 = Mesh(kangaroo_4.GeometryOut)
dist_5 = Distance(PointA=pt_8, PointB=demesh_28.Vertices)
bnd_5 = Bounds(Numbers=dist_5)
remap_5 = RemapNumbers(Value=dist_5, Source=bnd_5, Target=Domain(0, 1))  # -> Mapped, Clipped
gradient_5 = Gradient(
    LowerLimit=0,
    UpperLimit=1,
    Parameter=remap_5.Mapped,
    stops=[0.12: RGB(139, 0, 0), 0.289: RGB(240, 128, 128), 0.506: RGB(100, 149, 237), 0.512: RGB(175, 238, 238), 1: RGB(0, 0, 205)])
dist_6 = Distance(PointA=pt_4, PointB=demesh_24.Vertices)
bnd_6 = Bounds(Numbers=dist_6)
remap_6 = RemapNumbers(Value=dist_6, Source=bnd_6, Target=Domain(0, 1))  # -> Mapped, Clipped
gradient_6 = Gradient(
    LowerLimit=0,
    UpperLimit=1,
    Parameter=remap_6.Mapped,
    stops=[0.12: RGB(139, 0, 0), 0.289: RGB(240, 128, 128), 0.506: RGB(100, 149, 237), 0.512: RGB(175, 238, 238), 1: RGB(0, 0, 205)])
mcol_5 = MeshColours(Mesh=item_7, Colours=gradient_6)
dist_7 = Distance(PointA=pt_5, PointB=demesh_25.Vertices)
bnd_7 = Bounds(Numbers=dist_7)
remap_7 = RemapNumbers(Value=dist_7, Source=bnd_7, Target=Domain(0, 1))  # -> Mapped, Clipped
gradient_7 = Gradient(
    LowerLimit=0,
    UpperLimit=1,
    Parameter=remap_7.Mapped,
    stops=[0.12: RGB(139, 0, 0), 0.289: RGB(240, 128, 128), 0.506: RGB(100, 149, 237), 0.512: RGB(175, 238, 238), 1: RGB(0, 0, 205)])
mcol_6 = MeshColours(Mesh=item_8, Colours=gradient_7)
mcol_7 = MeshColours(Mesh=item_9, Colours=gradient_4)
mcol_8 = MeshColours(Mesh=item_10, Colours=gradient_3)
mcol_9 = MeshColours(Mesh=item_11, Colours=gradient_5)
dist_8 = Distance(PointA=pt_9, PointB=demesh_29.Vertices)
bnd_8 = Bounds(Numbers=dist_8)
remap_8 = RemapNumbers(Value=dist_8, Source=bnd_8, Target=Domain(0, 1))  # -> Mapped, Clipped
gradient_8 = Gradient(
    LowerLimit=0,
    UpperLimit=1,
    Parameter=remap_8.Mapped,
    stops=[0.12: RGB(139, 0, 0), 0.289: RGB(240, 128, 128), 0.506: RGB(100, 149, 237), 0.512: RGB(175, 238, 238), 1: RGB(0, 0, 205)])
dist_9 = Distance(PointA=pt_10, PointB=demesh_30.Vertices)
bnd_9 = Bounds(Numbers=dist_9)
remap_9 = RemapNumbers(Value=dist_9, Source=bnd_9, Target=Domain(0, 1))  # -> Mapped, Clipped
gradient_9 = Gradient(
    LowerLimit=0,
    UpperLimit=1,
    Parameter=remap_9.Mapped,
    stops=[0.12: RGB(139, 0, 0), 0.289: RGB(240, 128, 128), 0.506: RGB(100, 149, 237), 0.512: RGB(175, 238, 238), 1: RGB(0, 0, 205)])
mcol_10 = MeshColours(Mesh=item_13, Colours=gradient_9)
mcol_11 = MeshColours(Mesh=item_12, Colours=gradient_8)
dist_10 = Distance(PointA=pt_11, PointB=demesh_31.Vertices)
bnd_10 = Bounds(Numbers=dist_10)
remap_10 = RemapNumbers(Value=dist_10, Source=bnd_10, Target=Domain(0, 1))  # -> Mapped, Clipped
gradient_10 = Gradient(
    LowerLimit=0,
    UpperLimit=1,
    Parameter=remap_10.Mapped,
    stops=[0.12: RGB(139, 0, 0), 0.289: RGB(240, 128, 128), 0.506: RGB(100, 149, 237), 0.512: RGB(175, 238, 238), 1: RGB(0, 0, 205)])
mcol_12 = MeshColours(Mesh=item_14, Colours=gradient_10)
item_17 = ListItem(List=[mcol_8, mcol_7, mcol_11, mcol_5, mcol_6, mcol_9, mcol_12, mcol_10], Index=python_4.shape, Wrap=True)
move_3 = Move(Geometry=item_17, Motion=vec_20.Vector)  # -> Geometry, Transform

# ==== cluster Gravity: Apply gravity to vertices of a mesh
M = ClusterInput()
F = ClusterInput()
mcomp = Decompose(Mesh=M)  # -> Vertices, Faces, Colours, Normals
Z = UnitZ(Factor=F)
duppt = RemoveDuplicatePts(Points=mcomp.Vertices, Tolerance=0.01)
uforce = UnaryForce(Point=duppt, Force=Z)
U = ClusterOutput(uforce)
